# Grasshopper definition adaptive facade hops.gh (Grasshopper 1.0.7)
# plug-ins: Hops

panel = Panel("C:\Users\paude\Documents\00. Backup 2023\EXTERIOR\MASTER\MA IAAC\03. Cursada\01. Modulo 02\S3. dtmngmnt\02 Vue\00_Final_assignment\adaptive facade.gh")
hops = Hops(
    _Path=panel,
    Length=Slider(100, range=0..100),
    Height=Slider(50, range=0..100),
    Udiv=Slider(50, range=0..100),
    Vdiv=Slider(25, range=0..100),
    Inclination=Slider(0, range=0..7),
    Hour=Slider(0.82, range=0..1),
    CacheResultsInMemory=True,
    CacheSolveResults=True,
    RemoteDefinitionLocation="C:\Users\paude\Documents\00. Backup 2023\EXTERIOR\MASTER\MA IAAC\03. Cursada\01. Modulo 02\S3. dtmngmnt\02 Vue\00_Final_assignment\adaptive facade.gh",
    RemoteSolveVersion=(0, 1, 0),
    ShowInput_Enabled=False,
    ShowInput_Path=True,
    SynchronousSolve=True)
