# Grasshopper definition adaptive facade.gh (Grasshopper 1.0.7)
# plug-ins: LunchBox, ShapeDiverForGrasshopper, Human

inclination = GetInteger(Slider(0, range=0..7), AtLeast=1, AtMost=1, Maximum=2147483647, Minimum=-2147483648, TreeAccess=False)
hour = GetNumber(Slider(1, range=0..1), AtLeast=1, AtMost=1, Maximum=1.797693135e+308, Minimum=-1.797693135e+308, TreeAccess=False)
udiv = GetInteger(Slider(50, range=0..100), AtLeast=1, AtMost=1, Maximum=2147483647, Minimum=-2147483648, TreeAccess=False)
vdiv = GetInteger(Slider(25, range=0..100), AtLeast=1, AtMost=1, Maximum=2147483647, Minimum=-2147483648, TreeAccess=False)
length = GetNumber(Slider(100, range=0..100), AtLeast=1, AtMost=1, Maximum=1.797693135e+308, Minimum=-1.797693135e+308, TreeAccess=False)
height = GetNumber(Slider(50, range=0..100), AtLeast=1, AtMost=1, Maximum=1.797693135e+308, Minimum=-1.797693135e+308, TreeAccess=False)
md_slider = MDSlider(
    SliderMode=0,
    slider_value=Point(0.4969318669, 0, 0.5),
    x_domain=Domain(0, 1),
    y_domain=Domain(0, 1),
    z_domain=Domain(0, 1))
yz = YZPlane(Origin=Point(0, 0, 0))
rectangle = Rectangle(Plane=yz, XSize=length, YSize=height, Radius=0)  # -> Rectangle, Length
evalsrf = EvaluateSurface(Surface=reparameterize(rectangle.Rectangle), Point=md_slider)  # -> Point, Normal, UDirection, VDirection, Frame
orient = Orient(Geometry=rectangle.Rectangle, Source=evalsrf.Point, Target="0,0,0")  # -> Geometry, Transform
diamond = DiamondPanels(Surface=orient.Geometry, UDivisions=udiv, VDivisions=vdiv)  # -> DiamondPanels, TriPanels
cir = Circle(Plane="0,0,0", Radius=Slider(193, range=0..1000))
rotate = Rotate(Geometry=cir, Angle=1.570796327, Plane=PlaneXY(0, 0, 0))  # -> Geometry, Transform
area = Area(Geometry=diamond.DiamondPanels)  # -> Area, Centroid

genes = GenePool(Decimals=2, Maximum=1, Minimum=0, Value=[0.89, 0.38, 0.38, 0.58])
genes_2 = GenePool(Decimals=2, Maximum=1, Minimum=0, Value=[0, 0])
num2pt = NumbersToPoints(Numbers=genes_2, Mask=7)
num2pt_2 = NumbersToPoints(Numbers=genes, Mask=7)
partition = PartitionList(List=num2pt_2, Size="2")
evalsrf_2 = EvaluateSurface(Surface=reparameterize(orient.Geometry), Point=num2pt)  # -> Point, Normal, UDirection, VDirection, Frame
pull = PullPoint(Point=area.Centroid, Geometry=evalsrf_2.Point, ClosestOnly=True)  # -> ClosestPoint, Distance
bnd = Bounds(Numbers=pull.Distance)
dom = ConstructDomain(DomainStart=Slider(0, range=0..90), DomainEnd=Slider(90, range=0..90))
remap = RemapNumbers(Value=pull.Distance, Source=bnd, Target=dom)  # -> Mapped, Clipped
viewer = ParamViewer(remap.Mapped)

crv = Curve(rotate.Geometry)
disc = Discontinuity(Curve=diamond.DiamondPanels, Level=1)  # -> Points, Parameters
divide = DivideCurve(Curve=crv, Count=Slider(2, range=0..10), Kinks=False)  # -> Points, Tangents, Parameters
yz_2 = YZPlane(Origin=Point(0, 0, 0))
item = ListItem(List=divide.Points, Index=0, Wrap=True)  # -> Item, Item1
item_2 = ListItem(List=disc.Points, Index=0, Wrap=True)  # -> Item, Item1, Item2, Item3
arc = Arc(Plane=yz_2, Radius=1, Angle=Domain(0, 3.141592654))  # -> Arc, Length
ln = Line(StartPoint=item.Item, EndPoint=item.Item1)
rotate_y = Slider(0, range=0..100)
rotate_x = Slider(0, range=0..100)
ln_2 = Line(StartPoint=item_2.Item1, EndPoint=item_2.Item3)  # -> flatten(Line)
ln_3 = Line(StartPoint=item_2.Item, EndPoint=item_2.Item2)
rotax = RotateAxis(Geometry=crv, Angle=degrees("90"), Axis=ln)  # -> Geometry, Transform
viewer_2 = ParamViewer(diamond.DiamondPanels)
viewer_3 = ParamViewer(ln_2)
seam = Seam(Curve=reparameterize(rotax.Geometry), Seam=".75")
number_slider = Slider(0, range=0..90)
rotax_2 = RotateAxis(Geometry=diamond.DiamondPanels, Angle=degrees(rotate_y), Axis=ln_2)  # -> Geometry, Transform
divide_2 = DivideCurve(Curve=seam, Count="1", Kinks=False)  # -> Points, Tangents, Parameters
arc_2 = Arc3Pt(PointA=item.Item, PointB=divide_2.Points, PointC=item.Item1)  # -> Arc, Plane, Radius
series = Series(Start=0, Step="15", Count=Slider(7, range=0..10))
disc_2 = Discontinuity(Curve=rotax_2.Geometry, Level=1)  # -> Points, Parameters
item_3 = ListItem(List=series, Index=inclination, Wrap=True)
number_slider_2 = Slider(0.59, range=0..1)
rotax_3 = RotateAxis(Geometry=arc_2.Arc, Angle=degrees(item_3), Axis=ln)  # -> Geometry, Transform
item_4 = ListItem(List=disc_2.Points, Index=0, Wrap=True)  # -> Item, Item1, Item2, Item3
dash = DashPattern(Curve=[crv, rotax_3.Geometry], Pattern=Slider(5, range=0..10))  # -> Dashes, Gaps
ln_4 = Line(StartPoint=item_4.Item, EndPoint=item_4.Item2)  # -> flatten(Line)
curvepoint = PointOnCurve(rotax_3.Geometry, parameter=0)
ln_5 = Line(StartPoint=item_4.Item1, EndPoint=item_4.Item3)  # -> flatten(Line)
previewlw = CustomPreviewLineweights(Geometry=dash.Dashes, Shader="black", Thickness=Slider(2.82, range=1..10), Absolute=False)
eval = EvaluateCurve(Curve=reparameterize(rotax_3.Geometry), Parameter=hour)  # -> Point, Tangent, Angle
dom_2 = ConstructDomain(DomainStart=Slider(0, range=0..90), DomainEnd=Slider(90, range=0..90))
number_slider_3 = Slider(0, range=0..100)
pull_2 = PullPoint(Point=area.Centroid, Geometry=eval.Point, ClosestOnly=True)  # -> ClosestPoint, Distance
panel = Panel(curvepoint)
neg = Negative(Value=dom_2)
dots = DotDisplay(Point=pull_2.ClosestPoint, Colour="orange", Size=Slider(10, range=1..10))
sddp = ShapeDiverDocumentPayload({AbsoluteTolerance=0, AngleTolerance=0, DistanceDisplayPrecision=0, GltfVersion="Gltf2", GrasshopperVersion="1.0.0007", InputGroups="{}", OutputGroups="{}", RelativeTolerance=0, RhinoVersion="7.35.23346.11001", UnitSystem=0, VersionCreated="1.16.0.0", VersionSaved="1.16.0.0"})
bnd_2 = Bounds(Numbers=pull_2.Distance)
remap_2 = RemapNumbers(Value=pull_2.Distance, Source=bnd_2, Target=neg)  # -> Mapped, Clipped
rotax_4 = RotateAxis(Geometry=rotax_2.Geometry, Angle=degrees(remap_2.Mapped), Axis=ln_4)  # -> Geometry, Transform
debrep = DeconstructBrep(Brep=rotax_4.Geometry)  # -> Faces, Edges, Vertices
mesh = MeshBrep(
    Brep=rotax_4.Geometry,
    Settings={GridMaxCount=0, GridMinCount=16, JaggedSeams=False, MaxEdgeLength=0, MinEdgeLength=0.0001, MinTolerance=0, Refine=True, RefineAngle=0, RelativeTolerance=0.65, SimplePlanes=True, Tolerance=0})
previewlw_2 = CustomPreviewLineweights(Geometry=debrep.Edges, Shader=ColourSwatch(SwatchColor=RGB(0, 0, 0)), Absolute=False)
preview = CustomPreview(Geometry=rotax_4.Geometry, Material=ColourSwatch(SwatchColor=RGB(173, 173, 173)))
context_bake = ContextBake(Geometry=mesh)
