# Grasshopper definition urbanoBerlin.gh (Grasshopper 1.0.7)
# plug-ins: Urbano, Bifocals

panel = Panel("https://energyplus-weather.s3.amazonaws.com/europe_wmo_region_6/DEU/DEU_Berlin.103840_IWEC/DEU_Berlin.103840_IWEC.zip")
epwmap = LBEPWmap(epw_map=Toggle(False))  # -> report; plug-in component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
downloadepw = LBDownloadWeather(weather_URL=panel)  # -> epw_file, stat_file, ddy_file; plug-in component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
importepw = LBImportEPW(epw_file=downloadepw.epw_file)  # -> location, dry_bulb_temperature, dew_point_temperature, relative_humidity, wind_speed, wind_direction, direct_normal_rad, diffuse_horizontal_rad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; plug-in component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
number_slider = Slider(1, range=0..1)
panel_2 = Panel("1")
hoy = LBCalculateHOY(month=Slider(1, range=1..12), day=Slider(1, range=1..30), hour=Slider(18, range=0..23))  # -> flatten(hoy), flatten(doy), flatten(date); plug-in component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
pt = Point(Point(981.1488045, 552.9676515, 0))
button = Button()
# C:\Users\paude\Documents\00. Backup 2023\EXTERIOR\MASTER\MA IAAC\03. Cursada\01. Modulo 02\S3. dtmngmnt\02 Vue\00_Final_assignment
panel_3 = Panel("13.4044")
panel_4 = Panel("orthographic")
analysisperiod = LBAnalysisPeriod(start_month="1", start_day="1", start_hour="1")  # -> period, hoys, dates; plug-in component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
crv = Curve([<curve referenced from the Rhino model> x48])
downloadosm = DownloadOpenStreetMapOSM(LeftBound="13.4044", RightBound="13.4356", TopBound="52.5118", BottomBound="52.4994", RunToggle=True)  # -> OSMQueryURL, OSMFilePath
path = FilePath("C:\Users\paude\Documents\00. Backup 2023\EXTERIOR\MASTER\MA IAAC\03. Cursada\01. Modulo 02\S3. dtmngmnt\02 Vue\00_Final_assignment\berlin.osm")
item = ListItem(List=crv, Index=Slider(87, range=0..100), Wrap=True)  # -> Item, Item1, Item2, Item3
path_2 = FilePath("C:\Users\paude\Documents\00. Backup 2023\EXTERIOR\MASTER\MA IAAC\03. Cursada\01. Modulo 02\S3. dtmngmnt\02 Vue\00_Final_assignment\berlin.osm")
path_3 = FilePath("C:\Users\paude\Documents\00. Backup 2023\EXTERIOR\MASTER\MA IAAC\03. Cursada\01. Modulo 02\S3. dtmngmnt\02 Vue\00_Final_assignment\berlin.osm")
downloadosm_2 = DownloadOpenStreetMapOSM(LeftBound=panel_3, RightBound="13.4356", TopBound="52.5118", BottomBound="52.4994", RunToggle=False)  # -> OSMQueryURL, OSMFilePath
sunpath = LBSunPath(location=importepw.location, hoys=hoy.hoy, center_pt=pt, scale=Slider(30, range=0..100))  # -> report, vectors, altitudes, azimuths, hoys, sun_pts, analemma, daily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; plug-in component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
panel_5 = Panel(downloadosm.OSMQueryURL)
importosm = ImportOSMFeatures(OSMPathOrURL=path, OSMFeatureType="building", Format="xml", ImportAltitude=False)  # -> Points, Metadata, UTMZone, TranslationVector
importosm_2 = ImportOSMFeatures(OSMPathOrURL=path_2, OSMFeatureType="street", Format="xml", ImportAltitude=False)  # -> Points, Metadata, UTMZone, TranslationVector
importosm_3 = ImportOSMFeatures(OSMPathOrURL=path_3, OSMFeatureType="amenity", Format="xml", ImportAltitude=False)  # -> Points, Metadata, UTMZone, TranslationVector
data = Data(sunpath.compass)
crv_2 = Curve(sunpath.daily)
crv_3 = Curve(sunpath.analemma)
pline = PolyLine(Vertices=importosm.Points, Closed=False)
amen = CreateAmenity(PointLocationOfAmenity=importosm_3.Points, Metadata=importosm_3.Metadata)
pline_2 = PolyLine(Vertices=importosm_2.Points, Closed=False)
panel_6 = Panel(crv_3)
eval = EvaluateCurve(Curve=reparameterize(flatten(crv_3)), Parameter=Slider(0.02, range=0..1))  # -> Point, Tangent, Angle
streetnet = CreateStreetNetwork(
    StreetCurves=flatten(pline_2),
    Metadata=flatten(importosm_2.Metadata),
    SplitStreetCurves=True,
    UTMZone=importosm_2.UTMZone,
    TranslationVector=importosm_2.TranslationVector)  # -> StreetNetwork, StreetSegmentCurves, UTMZone, TranslationVector
arrgbybldg = ArrangeAmenitiesByBuilding(Amenities=flatten(amen), Buildings=flatten(pline))  # -> AmenitiesByBuilding, Buildings
lng = ListLength(List=eval.Point)
series = Series(Start=0, Step=1, Count=10)
bldg = CreateBuilding(BuildingCurve=pline, Metadata=importosm.Metadata, AmenitiesInBuilding=arrgbybldg.AmenitiesByBuilding)
range = Range(Domain=lng, Steps=10)
item_2 = ListItem(List=eval.Point, Index=0, Wrap=True)
model = BuildUrbanoModel(Buildings=flatten(bldg), StreetNetwork=streetnet.StreetNetwork, BuildToggle=True)  # -> UrbanoModel, BuildingCurves, Activities
inbldg = InspectBuilding(Building=model.BuildingCurves, DefaultHeight=10)  # -> Geometry, Metadata, Amenity, BuildingMesh
findamen = FindAmenities(UrbanoModel=model.UrbanoModel, Activity="Restaurant")
inamen = InspectAmenity(Amenity=findamen)  # -> Name, Activities, Host, Metadata
